# Grasshopper definition first.gh (Grasshopper 1.0.8)

len = Slider(85, range=0..100)
len_2 = Slider(5, range=0..60)
number_slider = Slider(12, range=0..100)
len_3 = Slider(90, range=0..100)
len_4 = Slider(50, range=0..60)
number_slider_2 = Slider(12, range=0..100)
pt = ConstructPoint(XCoordinate=0, YCoordinate=0, ZCoordinate=0)
multiplication = Multiplication(A=len_2, B=number_slider)
multiplication_2 = Multiplication(A=len, B=number_slider)
pt_2 = ConstructPoint(XCoordinate=0, YCoordinate=0, ZCoordinate=0)
multiplication_3 = Multiplication(A=len_4, B=number_slider_2)
multiplication_4 = Multiplication(A=len_3, B=number_slider_2)
vec = VectorXYZ(XComponent=multiplication, YComponent=multiplication_2, ZComponent=0)  # -> Vector, Length
pt_3 = Point(pt)
vec_2 = VectorXYZ(XComponent=multiplication_3, YComponent=multiplication_4, ZComponent=0)  # -> Vector, Length
pt_4 = Point(pt_2)
offset = Slider(6, range=0..9)
offset_2 = Slider(6, range=0..9)
move = Move(Geometry=pt_3, Motion=vec.Vector)  # -> Geometry, Transform
move_2 = Move(Geometry=pt_4, Motion=vec_2.Vector)  # -> Geometry, Transform
rec_2pt = Rectangle2Pt(Plane=PlaneXY(0, 0, 0), PointA=pt_3, PointB=move.Geometry, Radius=0)  # -> Rectangle, Length
neg = Negative(Value=offset)
rec_2pt_2 = Rectangle2Pt(Plane=PlaneXY(0, 0, 0), PointA=pt_4, PointB=move_2.Geometry, Radius=0)  # -> Rectangle, Length
neg_2 = Negative(Value=offset_2)
offset_3 = OffsetCurve(Curve=rec_2pt.Rectangle, Distance=neg, Corners=1)
offset_4 = OffsetCurve(Curve=rec_2pt_2.Rectangle, Distance=neg_2, Corners=1)
